# Dynamo graph Pipe_draw.dyn (Dynamo 3.0.3.7597)
# packages: MEPover 2024.9.25

code_block = CodeBlock { [-20000,-20000]; }
code_block_2 = CodeBlock { [0,6000]; }
byCoordinates = Point.ByCoordinates(x=code_block, y=code_block_2)
byPoints = PolyCurve.ByPoints(points=byCoordinates)
element_classes = ElementTypes("PipeType")
all_elements_of_class = ElementsOfType(element_class=element_classes)
code_block_3 = CodeBlock(x=all_elements_of_class) { x[0]; }
element_classes_2 = ElementTypes("PipingSystemType")
all_elements_of_class_2 = ElementsOfType(element_class=element_classes_2)
code_block_4 = CodeBlock(x=all_elements_of_class_2) { x[0]; }
levels = Levels("Уровень 2")
code_block_5 = CodeBlock { 20; }
byLines = Custom[Pipe.ByLines](Lines=byPoints, PipeType=code_block_3, SystemType=code_block_4, level=levels, Diameter=code_block_5)  # package MEPover; Creates a pipe by Line, PipeType, SystemType, Level and Diameter
